# Grasshopper definition zExtMeshField.gh (Grasshopper 1.0.8)

number_slider = Slider(20, range=0..100)
zspaceinitialiser = CSharpScript()  # -> out
# ---------- zspaceinitialiser: C# ----------
// Grasshopper Script Instance
#region Usings
using System;
#r "C:\Users\Taizhong.Chen\AppData\Roaming\Grasshopper\Libraries\zSpace\zSpace.External.dll"
using System.Linq;
using System.Collections;
using System.Collections.Generic;
using System.Drawing;

using Rhino;
using Rhino.Geometry;

using Grasshopper;
using Grasshopper.Kernel;
using Grasshopper.Kernel.Data;
using Grasshopper.Kernel.Types;

using zSpace.External;
#endregion

public class Script_Instance : GH_ScriptInstance
{
    #region Notes
    /* 
      Members:
        RhinoDoc RhinoDocument
        GH_Document GrasshopperDocument
        IGH_Component Component
        int Iteration

      Methods (Virtual & overridable):
        Print(string text)
        Print(string format, params object[] args)
        Reflect(object obj)
        Reflect(object obj, string method_name)
    */
    #endregion

    private void RunScript()
    {
       bool success = zSpaceExternal.Initialize();
       Print($"Successfully initialised zSpaceExternal dlls: {success}");
    }
}
# ---------- end zspaceinitialiser ----------
geo = Geometry(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)
number_slider_2 = Slider(20, range=0..100)
geo_2 = Geometry(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)
number_slider_3 = Slider(20, range=0..100)
geo_3 = Geometry(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)
panel = Panel(zspaceinitialiser)
createfield = CSharpScript(rect=geo, numX=number_slider, numY=number_slider)  # -> out, out_field, out_bounds; inputs rect: Rectangle3d, numX: Int32, numY: Int32
# ---------- createfield: C# ----------
// Grasshopper Script Instance
#region Usings
using System;
#r "C:\Users\Taizhong.Chen\AppData\Roaming\Grasshopper\Libraries\zSpace\zSpace.External.dll"
using System.Linq;
using System.Collections;
using System.Collections.Generic;
using System.Drawing;

using Rhino;
using Rhino.Geometry;

using Grasshopper;
using Grasshopper.Kernel;
using Grasshopper.Kernel.Data;
using Grasshopper.Kernel.Types;

using zSpace.External;
#endregion

public class Script_Instance : GH_ScriptInstance
{
    #region Notes
    /* 
      Members:
        RhinoDoc RhinoDocument
        GH_Document GrasshopperDocument
        IGH_Component Component
        int Iteration

      Methods (Virtual & overridable):
        Print(string text)
        Print(string format, params object[] args)
        Reflect(object obj)
        Reflect(object obj, string method_name)
    */
    #endregion

    private void RunScript(
		Rectangle3d rect,
		int numX,
		int numY,
		ref object out_field,
		ref object out_bounds)
    {
        zExtMeshField myField = new zExtMeshField();

        double[] minBB = {
            rect.BoundingBox.Min.X,
            rect.BoundingBox.Min.Y,
            rect.BoundingBox.Min.Z,
        };
    
        double[] maxBB = {
            rect.BoundingBox.Max.X,
            rect.BoundingBox.Max.Y,
            rect.BoundingBox.Max.Z,
        };

        myField.CreateField(minBB,maxBB,numX,numY);

        double[] b_min = new double[0];
        double[] b_max = new double[0];
        myField.GetBounds(out b_min, out b_max);

        Point3d[] bounds = new Point3d[2];
        bounds[0] = new Point3d(b_min[0], b_min[1],b_min[2]);
        bounds[1] = new Point3d(b_max[0], b_max[1],b_max[2]);
        
        out_field = myField;
        out_bounds = bounds;
    }
}
# ---------- end createfield ----------
geo_4 = Geometry(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)
number_slider_4 = Slider(20, range=0..100)
createfield_2 = CSharpScript(rect=geo_2, numX=number_slider_2, numY=number_slider_2)  # -> out, out_field, out_bounds; inputs rect: Rectangle3d, numX: Int32, numY: Int32; same code as createfield
createfield_3 = CSharpScript(rect=geo_3, numX=number_slider_3, numY=number_slider_3)  # -> out, out_field, out_bounds; inputs rect: Rectangle3d, numX: Int32, numY: Int32; same code as createfield
pt = Point(createfield.out_bounds)
pt_2 = Point(createfield_2.out_bounds)
createfield_4 = CSharpScript(rect=geo_4, numX=number_slider_4, numY=number_slider_4)  # -> out, out_field, out_bounds; inputs rect: Rectangle3d, numX: Int32, numY: Int32; same code as createfield
pt_3 = Point(createfield_3.out_bounds)
geo_5 = Geometry(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)
geo_6 = Geometry(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)
geo_7 = Geometry(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)
geo_8 = Geometry(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)
geo_9 = Geometry(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)
geo_10 = Geometry(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)
geo_11 = Geometry(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)
geo_12 = Geometry(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)
pt_4 = Point(createfield_4.out_bounds)
getscalarspolygon = CSharpScript(extField=createfield_2.out_field, polygon=geo_5, offset=Slider(0.05, range=0..0.1), normalise=Toggle(True))  # -> out, out_scalars; inputs polygon: Polyline, offset: Double, normalise: Boolean
# ---------- getscalarspolygon: C# ----------
// Grasshopper Script Instance
#region Usings
using System;
#r "C:\Users\Taizhong.Chen\AppData\Roaming\Grasshopper\Libraries\zSpace\zSpace.External.dll"
using System.Linq;
using System.Collections;
using System.Collections.Generic;
using System.Drawing;

using Rhino;
using Rhino.Geometry;

using Grasshopper;
using Grasshopper.Kernel;
using Grasshopper.Kernel.Data;
using Grasshopper.Kernel.Types;

using zSpace.External;
#endregion

public class Script_Instance : GH_ScriptInstance
{
    #region Notes
    /* 
      Members:
        RhinoDoc RhinoDocument
        GH_Document GrasshopperDocument
        IGH_Component Component
        int Iteration

      Methods (Virtual & overridable):
        Print(string text)
        Print(string format, params object[] args)
        Reflect(object obj)
        Reflect(object obj, string method_name)
    */
    #endregion

    private void RunScript(
		object extField,
		Polyline polygon,
		double offset,
		bool normalise,
		ref object out_scalars)
    {
        if(!polygon.IsClosed) throw new Exception("Input polygon must be closed");

        zExtMeshField myField = (zExtMeshField) extField;

        zExtGraph graph = graphFromPolyline(polygon);
        out_scalars = myField.GetScalarsPolygon(graph, normalise);
    }

    private zExtGraph graphFromPolyline(Polyline poly)
    {
        zExtGraph graph = new zExtGraph();

        int numVertices = poly.IsClosed ? poly.Count - 1: poly.Count;
        double[] pos = new double[numVertices * 3];
        int[] eConnects = new int[numVertices  * 2];

        for(int i = 0; i < numVertices; i++)
        {
            pos[i * 3 + 0] = poly[i].X;
            pos[i * 3 + 1] = poly[i].Y;
            pos[i * 3 + 2] = poly[i].Z;

            eConnects[i * 2 + 0] = i;
            eConnects[i * 2 + 1] = i + 1;
        }

        if(poly.IsClosed)
            eConnects[eConnects.Length - 1] = eConnects[0];

        graph.CreateGraph(pos,eConnects);
        return graph;
    }

    private zExtGraph graphFromLines(Line[] lines)
    {
        zExtGraph graph = new zExtGraph();

        double[] pos = new double[lines.Length * 2 * 3];
        int[] eConnects = new int[lines.Length * 2];

        for(int i = 0; i < lines.Length; i++)
        {
            Point3d start = lines[i].From;
            Point3d end = lines[i].To;

            pos[i * 6 + 0] = start.X;
            pos[i * 6 + 1] = start.Y;
            pos[i * 6 + 2] = start.Z;
            pos[i * 6 + 3] = end.X;
            pos[i * 6 + 4] = end.Y;
            pos[i * 6 + 5] = end.Z;

            eConnects[i * 2 + 0] = i;
            eConnects[i * 2 + 1] = i + 1;
        }

        graph.CreateGraph(pos,eConnects);
        return graph;
    }
}
# ---------- end getscalarspolygon ----------
getscalarspolygon_2 = CSharpScript(extField=createfield_2.out_field, polygon=geo_6, offset=Slider(0.05, range=0..0.1), normalise=Toggle(True))  # -> out, out_scalars; inputs polygon: Polyline, offset: Double, normalise: Boolean; same code as getscalarspolygon
getscalarspolygon_3 = CSharpScript(extField=createfield_2.out_field, polygon=geo_7, offset=Slider(0.05, range=0..0.1), normalise=Toggle(True))  # -> out, out_scalars; inputs polygon: Polyline, offset: Double, normalise: Boolean; same code as getscalarspolygon
getscalarspolygon_4 = CSharpScript(extField=createfield.out_field, polygon=geo_8, offset=Slider(0.05, range=0..0.1), normalise=Toggle(True))  # -> out, out_scalars; inputs polygon: Polyline, offset: Double, normalise: Boolean; same code as getscalarspolygon
getscalarspolygon_5 = CSharpScript(extField=createfield.out_field, polygon=geo_9, offset=Slider(0.05, range=0..0.1), normalise=Toggle(True))  # -> out, out_scalars; inputs polygon: Polyline, offset: Double, normalise: Boolean; same code as getscalarspolygon
getscalarspolygon_6 = CSharpScript(extField=createfield_3.out_field, polygon=geo_10, offset=Slider(0.05, range=0..0.1), normalise=Toggle(True))  # -> out, out_scalars; inputs polygon: Polyline, offset: Double, normalise: Boolean; same code as getscalarspolygon
getscalarspolygon_7 = CSharpScript(extField=createfield_3.out_field, polygon=geo_11, offset=Slider(0.05, range=0..0.1), normalise=Toggle(True))  # -> out, out_scalars; inputs polygon: Polyline, offset: Double, normalise: Boolean; same code as getscalarspolygon
getscalarspolygon_8 = CSharpScript(extField=createfield_3.out_field, polygon=geo_12, offset=Slider(0.05, range=0..0.1), normalise=Toggle(True))  # -> out, out_scalars; inputs polygon: Polyline, offset: Double, normalise: Boolean; same code as getscalarspolygon

# ---- group: GetScalars
pt_5 = Point(Point(0, 0, 0))
geo_13 = Geometry(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)
geo_14 = Geometry(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)
geo_15 = Geometry([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])
getscalarspolygon_9 = CSharpScript(extField=createfield_4.out_field, polygon=geo_13, offset=Slider(0.05, range=0..0.1), normalise=Toggle(True))  # -> out, out_scalars; inputs polygon: Polyline, offset: Double, normalise: Boolean; same code as getscalarspolygon
getscalarscircle = CSharpScript(
    extField=createfield_4.out_field,
    pos=pt_5,
    radius=Slider(1, range=0..1),
    offset=Slider(0.05, range=0..0.1),
    normalise=Toggle(True))  # -> out, out_scalars; inputs pos: Point3d, radius: Double, offset: Double, normalise: Boolean
# ---------- getscalarscircle: C# ----------
// Grasshopper Script Instance
#region Usings
using System;
#r "C:\Users\Taizhong.Chen\AppData\Roaming\Grasshopper\Libraries\zSpace\zSpace.External.dll"
using System.Linq;
using System.Collections;
using System.Collections.Generic;
using System.Drawing;

using Rhino;
using Rhino.Geometry;

using Grasshopper;
using Grasshopper.Kernel;
using Grasshopper.Kernel.Data;
using Grasshopper.Kernel.Types;

using zSpace.External;
#endregion

public class Script_Instance : GH_ScriptInstance
{
    #region Notes
    /* 
      Members:
        RhinoDoc RhinoDocument
        GH_Document GrasshopperDocument
        IGH_Component Component
        int Iteration

      Methods (Virtual & overridable):
        Print(string text)
        Print(string format, params object[] args)
        Reflect(object obj)
        Reflect(object obj, string method_name)
    */
    #endregion

    private void RunScript(
		object extField,
		Point3d pos,
		double radius,
		double offset,
		bool normalise,
		ref object out_scalars)
    {
        zExtMeshField myField = (zExtMeshField) extField;

        double[] cen = {pos.X,pos.Y,pos.Z};
        out_scalars = myField.GetScalarsCircle(cen, (float)radius, (float)offset, normalise);
    }
}
# ---------- end getscalarscircle ----------
getscalarsline = CSharpScript(extField=createfield_4.out_field, line=geo_14, offset=Slider(0.05, range=0..0.1), normalise=Toggle(True))  # -> out, out_scalars; inputs line: Line, offset: Double, normalise: Boolean
# ---------- getscalarsline: C# ----------
// Grasshopper Script Instance
#region Usings
using System;
#r "C:\Users\Taizhong.Chen\AppData\Roaming\Grasshopper\Libraries\zSpace\zSpace.External.dll"
using System.Linq;
using System.Collections;
using System.Collections.Generic;
using System.Drawing;

using Rhino;
using Rhino.Geometry;

using Grasshopper;
using Grasshopper.Kernel;
using Grasshopper.Kernel.Data;
using Grasshopper.Kernel.Types;

using zSpace.External;
#endregion

public class Script_Instance : GH_ScriptInstance
{
    #region Notes
    /* 
      Members:
        RhinoDoc RhinoDocument
        GH_Document GrasshopperDocument
        IGH_Component Component
        int Iteration

      Methods (Virtual & overridable):
        Print(string text)
        Print(string format, params object[] args)
        Reflect(object obj)
        Reflect(object obj, string method_name)
    */
    #endregion

    private void RunScript(
		object extField,
		Line line,
		double offset,
		bool normalise,
		ref object out_scalars)
    {
        zExtMeshField myField = (zExtMeshField) extField;

        double[] start = {line.From.X,line.From.Y,line.From.Z};
        double[] end = {line.To.X,line.To.Y,line.To.Z};
        out_scalars = myField.GetScalarsLine(start, end, (float)offset, normalise);
    }
}
# ---------- end getscalarsline ----------
getscalarsgraph = CSharpScript(extField=createfield_4.out_field, lines=geo_15, offset=Slider(0.05, range=0..0.1), normalise=Toggle(True))  # -> out, out_scalars; inputs lines: list of Line, offset: Double, normalise: Boolean
# ---------- getscalarsgraph: C# ----------
// Grasshopper Script Instance
#region Usings
using System;
#r "C:\Users\Taizhong.Chen\AppData\Roaming\Grasshopper\Libraries\zSpace\zSpace.External.dll"
using System.Linq;
using System.Collections;
using System.Collections.Generic;
using System.Drawing;

using Rhino;
using Rhino.Geometry;

using Grasshopper;
using Grasshopper.Kernel;
using Grasshopper.Kernel.Data;
using Grasshopper.Kernel.Types;

using zSpace.External;
#endregion

public class Script_Instance : GH_ScriptInstance
{
    #region Notes
    /* 
      Members:
        RhinoDoc RhinoDocument
        GH_Document GrasshopperDocument
        IGH_Component Component
        int Iteration

      Methods (Virtual & overridable):
        Print(string text)
        Print(string format, params object[] args)
        Reflect(object obj)
        Reflect(object obj, string method_name)
    */
    #endregion

    private void RunScript(
		object extField,
		List<Line> lines,
		double offset,
		bool normalise,
		ref object out_scalars)
    {
        zExtMeshField myField = (zExtMeshField) extField;

        zExtGraph graph = graphFromLines(lines.ToArray());
        out_scalars = myField.GetScalarsGraphEdgeDistance(graph, (float)offset, normalise);
    }

    private zExtGraph graphFromLines(Line[] lines)
    {
        zExtGraph graph = new zExtGraph();

        double[] pos = new double[lines.Length * 2 * 3];
        int[] eConnects = new int[lines.Length * 2];

        for(int i = 0; i < lines.Length; i++)
        {
            Point3d start = lines[i].From;
            Point3d end = lines[i].To;

            pos[i * 6 + 0] = start.X;
            pos[i * 6 + 1] = start.Y;
            pos[i * 6 + 2] = start.Z;
            pos[i * 6 + 3] = end.X;
            pos[i * 6 + 4] = end.Y;
            pos[i * 6 + 5] = end.Z;

            eConnects[i * 2 + 0] = i * 2;
            eConnects[i * 2 + 1] = i * 2 + 1;
        }

        graph.CreateGraph(pos,eConnects);
        return graph;
    }
}
# ---------- end getscalarsgraph ----------
panel_2 = Panel(getscalarspolygon_9.out_scalars)
panel_3 = Panel(getscalarscircle.out_scalars)
panel_4 = Panel(getscalarsline.out_scalars)
panel_5 = Panel(getscalarsgraph.out_scalars)

# ---- group: SMin
list = ValueList({"min": 0, "exponential": 1, "root": 2, "sigmoid": 3, "polynomial_quadratic": 4, "polynomial_cubic": 5, "polynomial_quartic": 6, "circular": 7, "circular_geometrical": 8}, selected="root")
smin = CSharpScript(
    extField=createfield_2.out_field,
    scalarsA=getscalarspolygon_2.out_scalars,
    scalarsB=getscalarspolygon.out_scalars,
    k=Slider(0.08, range=0..0.1),
    mode=list)  # -> out, out_scalars; inputs scalarsA: list of Double, scalarsB: list of Double, k: Double, mode: Int32
# ---------- smin: C# ----------
// Grasshopper Script Instance
#region Usings
using System;
#r "C:\Users\Taizhong.Chen\AppData\Roaming\Grasshopper\Libraries\zSpace\zSpace.External.dll"
using System.Linq;
using System.Collections;
using System.Collections.Generic;
using System.Drawing;

using Rhino;
using Rhino.Geometry;

using Grasshopper;
using Grasshopper.Kernel;
using Grasshopper.Kernel.Data;
using Grasshopper.Kernel.Types;

using zSpace.External;
#endregion

public class Script_Instance : GH_ScriptInstance
{
    #region Notes
    /* 
      Members:
        RhinoDoc RhinoDocument
        GH_Document GrasshopperDocument
        IGH_Component Component
        int Iteration

      Methods (Virtual & overridable):
        Print(string text)
        Print(string format, params object[] args)
        Reflect(object obj)
        Reflect(object obj, string method_name)
    */
    #endregion

    private void RunScript(
		object extField,
		List<double> scalarsA,
		List<double> scalarsB,
		double k,
		int mode,
		ref object out_scalars)
    {
        zExtMeshField myField = (zExtMeshField) extField;

        out_scalars = myField.GetScalarsSMin(
            scalarsA.Select(d=>(float)d).ToArray(),
            scalarsB.Select(d=>(float)d).ToArray(),
            (float)k,
            mode
            );
    }
}
# ---------- end smin ----------

# ---- group: SMin_multiple
list_2 = ValueList({"min": 0, "exponential": 1, "root": 2, "sigmoid": 3, "polynomial_quadratic": 4, "polynomial_cubic": 5, "polynomial_quartic": 6, "circular": 7, "circular_geometrical": 8}, selected="root")
smin_2 = CSharpScript(extField=createfield_2.out_field, k=Slider(0.08, range=0..0.1), mode=list_2)  # -> out, out_scalars; inputs scalarsArray: tree of Double, k: Double, mode: Int32
# ---------- smin_2: C# ----------
// Grasshopper Script Instance
#region Usings
using System;
#r "C:\Users\Taizhong.Chen\AppData\Roaming\Grasshopper\Libraries\zSpace\zSpace.External.dll"
using System.Linq;
using System.Collections;
using System.Collections.Generic;
using System.Drawing;

using Rhino;
using Rhino.Geometry;

using Grasshopper;
using Grasshopper.Kernel;
using Grasshopper.Kernel.Data;
using Grasshopper.Kernel.Types;

using zSpace.External;
#endregion

public class Script_Instance : GH_ScriptInstance
{
    #region Notes
    /* 
      Members:
        RhinoDoc RhinoDocument
        GH_Document GrasshopperDocument
        IGH_Component Component
        int Iteration

      Methods (Virtual & overridable):
        Print(string text)
        Print(string format, params object[] args)
        Reflect(object obj)
        Reflect(object obj, string method_name)
    */
    #endregion

    private void RunScript(
		object extField,
		DataTree<double> scalarsArray,
		double k,
		int mode,
		ref object out_scalars)
    {
        zExtMeshField myField = (zExtMeshField) extField;
        float[] scalars = new float[0];

        for(int i = 0; i < scalarsArray.BranchCount; i++)
        {
            if(scalarsArray.Branch(i).Count>0)
                if(i==0) scalars = scalarsArray.Branch(i).Select(d=>(float)d).ToArray();
                else
                {
                    scalars = myField.GetScalarsSMin(
                        scalars,
                        scalarsArray.Branch(i).Select(d=>(float)d).ToArray(),
                        (float)k,
                        mode
                    );
                }
        }
        out_scalars = scalars;
    }
}
# ---------- end smin_2 ----------

# ---- group: SMin
list_3 = ValueList({"min": 0, "exponential": 1, "root": 2, "sigmoid": 3, "polynomial_quadratic": 4, "polynomial_cubic": 5, "polynomial_quartic": 6, "circular": 7, "circular_geometrical": 8}, selected="exponential")
smin_3 = CSharpScript(
    extField=createfield.out_field,
    scalarsA=getscalarspolygon_5.out_scalars,
    scalarsB=getscalarspolygon_4.out_scalars,
    k=Slider(0.07, range=0..0.1),
    mode=list_3)  # -> out, out_scalars; inputs scalarsA: list of Double, scalarsB: list of Double, k: Double, mode: Int32; same code as smin

# ---- group: SMin_exponential_weighted
list_4 = ValueList({"min": 0, "exponential": 1, "root": 2, "sigmoid": 3, "polynomial_quadratic": 4, "polynomial_cubic": 5, "polynomial_quartic": 6, "circular": 7, "circular_geometrical": 8}, selected="root")
smin_4 = CSharpScript(
    extField=createfield_3.out_field,
    scalarsA=getscalarspolygon_7.out_scalars,
    scalarsB=getscalarspolygon_6.out_scalars,
    k=Slider(0.08, range=0..0.1),
    mode=list_4)  # -> out, out_scalars; inputs scalarsA: list of Double, scalarsB: list of Double, k: Double, mode: Int32; same code as smin

smin_5 = CSharpScript(
    extField=createfield_2.out_field,
    scalarsA=smin.out_scalars,
    scalarsB=getscalarspolygon_3.out_scalars,
    k=Slider(0.03, range=0..0.1),
    wt=Slider(0, range=0..1))  # -> out, out_scalars; inputs scalarsA: list of Double, scalarsB: list of Double, k: Double, wt: Double
# ---------- smin_5: C# ----------
// Grasshopper Script Instance
#region Usings
using System;
#r "C:\Users\Taizhong.Chen\AppData\Roaming\Grasshopper\Libraries\zSpace\zSpace.External.dll"
using System.Linq;
using System.Collections;
using System.Collections.Generic;
using System.Drawing;

using Rhino;
using Rhino.Geometry;

using Grasshopper;
using Grasshopper.Kernel;
using Grasshopper.Kernel.Data;
using Grasshopper.Kernel.Types;

using zSpace.External;
#endregion

public class Script_Instance : GH_ScriptInstance
{
    #region Notes
    /* 
      Members:
        RhinoDoc RhinoDocument
        GH_Document GrasshopperDocument
        IGH_Component Component
        int Iteration

      Methods (Virtual & overridable):
        Print(string text)
        Print(string format, params object[] args)
        Reflect(object obj)
        Reflect(object obj, string method_name)
    */
    #endregion

    private void RunScript(
		object extField,
		List<double> scalarsA,
		List<double> scalarsB,
		double k,
		double wt,
		ref object out_scalars)
    {
        zExtMeshField myField = (zExtMeshField) extField;

        out_scalars = myField.GetScalarsSMinExponentialWeighted(
            scalarsA.Select(d=>(float)d).ToArray(),
            scalarsB.Select(d=>(float)d).ToArray(),
            (float)k,
            (float)wt
            );
    }
}
# ---------- end smin_5 ----------

# ---- group: Boolean
list_5 = ValueList({"Union": 0, "Subtract": 1, "Difference": 2, "Intersect": 3}, selected="Union")
smin_6 = CSharpScript(extField=createfield_3.out_field, scalarsA=smin_4.out_scalars, scalarsB=getscalarspolygon_8.out_scalars, mode=list_5)  # -> out, out_scalars; inputs scalarsA: list of Double, scalarsB: list of Double, mode: Int32
# ---------- smin_6: C# ----------
// Grasshopper Script Instance
#region Usings
using System;
#r "C:\Users\Taizhong.Chen\AppData\Roaming\Grasshopper\Libraries\zSpace\zSpace.External.dll"
using System.Linq;
using System.Collections;
using System.Collections.Generic;
using System.Drawing;

using Rhino;
using Rhino.Geometry;

using Grasshopper;
using Grasshopper.Kernel;
using Grasshopper.Kernel.Data;
using Grasshopper.Kernel.Types;

using zSpace.External;
#endregion

public class Script_Instance : GH_ScriptInstance
{
    #region Notes
    /* 
      Members:
        RhinoDoc RhinoDocument
        GH_Document GrasshopperDocument
        IGH_Component Component
        int Iteration

      Methods (Virtual & overridable):
        Print(string text)
        Print(string format, params object[] args)
        Reflect(object obj)
        Reflect(object obj, string method_name)
    */
    #endregion

    private void RunScript(
		object extField,
		List<double> scalarsA,
		List<double> scalarsB,
		int mode,
		ref object out_scalars)
    {
        zExtMeshField myField = (zExtMeshField) extField;

        float[] scalars = new float[0];
        switch(mode)
        {
            case 0:
                scalars = myField.BooleanUnion(
                scalarsA.Select(d=>(float)d).ToArray(),
                scalarsB.Select(d=>(float)d).ToArray()
                );
                break;
            case 1:
                scalars = myField.BooleanSubtract(
                scalarsA.Select(d=>(float)d).ToArray(),
                scalarsB.Select(d=>(float)d).ToArray()
                );
                break;
            case 2:
                scalars = myField.BooleanDifference(
                scalarsA.Select(d=>(float)d).ToArray(),
                scalarsB.Select(d=>(float)d).ToArray()
                );
                break;
            case 3:
                scalars = myField.BooleanIntersect(
                scalarsA.Select(d=>(float)d).ToArray(),
                scalarsB.Select(d=>(float)d).ToArray()
                );
                break;
            default:
                scalars = myField.BooleanUnion(
                scalarsA.Select(d=>(float)d).ToArray(),
                scalarsB.Select(d=>(float)d).ToArray()
                );
                break;
        }

        out_scalars = scalars;
    }
}
# ---------- end smin_6 ----------

# ----
data = Data(smin_5.out_scalars)
data_2 = Data(smin_3.out_scalars)
data_3 = Data(smin_6.out_scalars)
data_4 = Data(panel_5)

# ---- group: FieldViz
getfieldmesh = CSharpScript(extField=createfield_2.out_field)  # -> out, out_mesh
# ---------- getfieldmesh: C# ----------
// Grasshopper Script Instance
#region Usings
using System;
#r "C:\Users\Taizhong.Chen\AppData\Roaming\Grasshopper\Libraries\zSpace\zSpace.External.dll"
using System.Linq;
using System.Collections;
using System.Collections.Generic;
using System.Drawing;

using Rhino;
using Rhino.Geometry;

using Grasshopper;
using Grasshopper.Kernel;
using Grasshopper.Kernel.Data;
using Grasshopper.Kernel.Types;

using zSpace.External;
#endregion

public class Script_Instance : GH_ScriptInstance
{
    #region Notes
    /* 
      Members:
        RhinoDoc RhinoDocument
        GH_Document GrasshopperDocument
        IGH_Component Component
        int Iteration

      Methods (Virtual & overridable):
        Print(string text)
        Print(string format, params object[] args)
        Reflect(object obj)
        Reflect(object obj, string method_name)
    */
    #endregion

    private void RunScript(object extField, ref object out_mesh)
    {
        zExtMeshField myField = (zExtMeshField) extField;

        double[] vertices = new double[0];
        int[] polyCounts = new int[0];
        int[] polyConnects = new int[0];
        myField.GetMesh().GetMeshData(out vertices, out polyCounts, out polyConnects);

        out_mesh = MeshFromData(vertices, polyCounts,polyConnects);
    }


    private Mesh MeshFromData(double[] vertices, int[] polyCounts, int[] polyConnections)
    {
        // 1) Create a new empty mesh
        Mesh mesh = new Mesh();

        // 2) Add vertices to the mesh
        int vertexCount = vertices.Length / 3;
        for (int i = 0; i < vertexCount; i++)
        {
            double x = vertices[i * 3];
            double y = vertices[i * 3 + 1];
            double z = vertices[i * 3 + 2];
            mesh.Vertices.Add(x, y, z);
        }

        // 3) Add faces
        int connectionIndex = 0;
        for (int i = 0; i < polyCounts.Length; i++)
        {
            int faceSize = polyCounts[i];

            // Ensure we don’t go out of bounds on polyConnections
            if (connectionIndex + faceSize > polyConnections.Length)
                throw new IndexOutOfRangeException("polyConnections array too small for given polyCounts.");

            if (faceSize == 3)
            {
                // Triangle face
                int a = polyConnections[connectionIndex++];
                int b = polyConnections[connectionIndex++];
                int c = polyConnections[connectionIndex++];
                mesh.Faces.AddFace(a, b, c);
            }
            else if (faceSize == 4)
            {
                // Quad face
                int a = polyConnections[connectionIndex++];
                int b = polyConnections[connectionIndex++];
                int c = polyConnections[connectionIndex++];
                int d = polyConnections[connectionIndex++];
                mesh.Faces.AddFace(a, b, c, d);
            }
            else
            {
                // If the data includes faces that aren't triangles/quads, handle as needed.
                // For example, skip or throw an error. Here, we’ll just throw:
                throw new NotSupportedException($"Face with {faceSize} vertices is not supported.");
            }
        }

        // 4) Recompute normals, compact the mesh, etc. as needed
        mesh.Normals.ComputeNormals();
        mesh.Compact();

        return mesh;
    }

    private void GetMeshData(Mesh mesh, out double[] vertices, out int[] polyCounts, out int[] polyConnections)
    {
        // Convert vertices
        int vertexCount = mesh.Vertices.Count;
        vertices = new double[vertexCount * 3];
        for (int i = 0; i < vertexCount; i++)
        {
            var pt = mesh.Vertices[i];
            vertices[i * 3] = pt.X;
            vertices[i * 3 + 1] = pt.Y;
            vertices[i * 3 + 2] = pt.Z;
        }

        // Convert faces:
        int faceCount = mesh.Faces.Count;
        polyCounts = new int[faceCount];

        // First, calculate the total number of indices needed.
        int totalIndices = 0;
        for (int i = 0; i < faceCount; i++)
        {
            var face = mesh.Faces[i];
            totalIndices += face.IsTriangle ? 3 : 4;
        }

        polyConnections = new int[totalIndices];

        // Fill in polyCounts and polyConnections
        int index = 0;
        for (int i = 0; i < faceCount; i++)
        {
            var face = mesh.Faces[i];
            if (face.IsTriangle)
            {
                polyCounts[i] = 3;
                polyConnections[index++] = face.A;
                polyConnections[index++] = face.B;
                polyConnections[index++] = face.C;
            }
            else // quad face
            {
                polyCounts[i] = 4;
                polyConnections[index++] = face.A;
                polyConnections[index++] = face.B;
                polyConnections[index++] = face.C;
                polyConnections[index++] = face.D;
            }
        }
    }
}
# ---------- end getfieldmesh ----------
mesh = Mesh(getfieldmesh.out_mesh)
data_5 = Data(data)
bnd = Bounds(Numbers=data_5)
dedomain = DeconstructDomain(Domain=bnd)  # -> Start, End
gradient = Gradient(
    LowerLimit=dedomain.Start,
    UpperLimit=dedomain.End,
    Parameter=data_5,
    stops=[0: RGB(234, 38, 0), 0.25: RGB(234, 126, 0), 0.5: RGB(254, 244, 84), 0.75: RGB(173, 203, 249), 1: RGB(75, 107, 169)])
c_script = CSharpScript(x=data_5, y="2")  # -> out, a; inputs x: Double, y: Int32
# ---------- c_script: C# ----------
// Grasshopper Script Instance
#region Usings
using System;
using System.Linq;
using System.Collections;
using System.Collections.Generic;
using System.Drawing;

using Rhino;
using Rhino.Geometry;

using Grasshopper;
using Grasshopper.Kernel;
using Grasshopper.Kernel.Data;
using Grasshopper.Kernel.Types;
#endregion

public class Script_Instance : GH_ScriptInstance
{
    #region Notes
    /* 
      Members:
        RhinoDoc RhinoDocument
        GH_Document GrasshopperDocument
        IGH_Component Component
        int Iteration

      Methods (Virtual & overridable):
        Print(string text)
        Print(string format, params object[] args)
        Reflect(object obj)
        Reflect(object obj, string method_name)
    */
    #endregion

    private void RunScript(double x, int y, ref object a)
    {
        // Write your logic here
        a = Math.Round(x,y);
    }
}
# ---------- end c_script ----------
demesh = DeconstructMesh(Mesh=mesh)  # -> Vertices, Faces, Colours, Normals
mcol = MeshColours(Mesh=mesh, Colours=gradient)
tag = TextTag(Location=demesh.Vertices, Text=c_script.a)

getfieldmesh_2 = CSharpScript(extField=createfield.out_field)  # -> out, out_mesh; same code as getfieldmesh
mesh_2 = Mesh(getfieldmesh_2.out_mesh)
data_6 = Data(data_2)
bnd_2 = Bounds(Numbers=data_6)
dedomain_2 = DeconstructDomain(Domain=bnd_2)  # -> Start, End
gradient_2 = Gradient(
    LowerLimit=dedomain_2.Start,
    UpperLimit=dedomain_2.End,
    Parameter=data_6,
    stops=[0: RGB(234, 38, 0), 0.25: RGB(234, 126, 0), 0.5: RGB(254, 244, 84), 0.75: RGB(173, 203, 249), 1: RGB(75, 107, 169)])
c_script_2 = CSharpScript(x=data_6, y="2")  # -> out, a; inputs x: Double, y: Int32; same code as c_script
demesh_2 = DeconstructMesh(Mesh=mesh_2)  # -> Vertices, Faces, Colours, Normals
mcol_2 = MeshColours(Mesh=mesh_2, Colours=gradient_2)
tag_2 = TextTag(Location=demesh_2.Vertices, Text=c_script_2.a)

# ---- group: GetIsoContour
setfieldvalues = CSharpScript(extField=createfield_2.out_field, scalars=data)  # -> out, out_field; inputs scalars: list of Double
# ---------- setfieldvalues: C# ----------
// Grasshopper Script Instance
#region Usings
using System;
#r "C:\Users\Taizhong.Chen\AppData\Roaming\Grasshopper\Libraries\zSpace\zSpace.External.dll"
using System.Linq;
using System.Collections;
using System.Collections.Generic;
using System.Drawing;

using Rhino;
using Rhino.Geometry;

using Grasshopper;
using Grasshopper.Kernel;
using Grasshopper.Kernel.Data;
using Grasshopper.Kernel.Types;

using zSpace.External;
#endregion

public class Script_Instance : GH_ScriptInstance
{
    #region Notes
    /* 
      Members:
        RhinoDoc RhinoDocument
        GH_Document GrasshopperDocument
        IGH_Component Component
        int Iteration

      Methods (Virtual & overridable):
        Print(string text)
        Print(string format, params object[] args)
        Reflect(object obj)
        Reflect(object obj, string method_name)
    */
    #endregion

    private void RunScript(
		object extField,
		List<double> scalars,
		ref object out_field)
    {
        zExtMeshField myField = (zExtMeshField) extField;
        myField.SetFieldValues(scalars.Select(d => (float)d).ToArray());
        out_field = myField;
    }
}
# ---------- end setfieldvalues ----------
getisocontour = CSharpScript(extField=setfieldvalues.out_field, offset=Slider(0.22, range=0..1))  # -> out, out_contour; inputs offset: Double
# ---------- getisocontour: C# ----------
// Grasshopper Script Instance
#region Usings
using System;
#r "C:\Users\Taizhong.Chen\AppData\Roaming\Grasshopper\Libraries\zSpace\zSpace.External.dll"
using System.Linq;
using System.Collections;
using System.Collections.Generic;
using System.Drawing;

using Rhino;
using Rhino.Geometry;

using Grasshopper;
using Grasshopper.Kernel;
using Grasshopper.Kernel.Data;
using Grasshopper.Kernel.Types;

using zSpace.External;
#endregion

public class Script_Instance : GH_ScriptInstance
{
    #region Notes
    /* 
      Members:
        RhinoDoc RhinoDocument
        GH_Document GrasshopperDocument
        IGH_Component Component
        int Iteration

      Methods (Virtual & overridable):
        Print(string text)
        Print(string format, params object[] args)
        Reflect(object obj)
        Reflect(object obj, string method_name)
    */
    #endregion

    private void RunScript(object extField, double offset, ref object out_contour)
    {

        zExtMeshField myField = (zExtMeshField) extField;

        zExtGraph contour = myField.GetIsoContour((float)offset);

        contour.MergeVertices(1e-5);
        zExtGraph[] separated = contour.SeparateGraph();

        List<Polyline> polys = new List<Polyline>();
        for(int i = 0; i < separated.Length; i ++)
        {
            polys.Add(GraphToPolyline(separated[i]));
        }
        out_contour = polys;
    }

        private Polyline GraphToPolyline(zExtGraph graph)
    {
        Polyline poly = new Polyline();

        if(graph.VertexCount!=0 && graph.EdgeCount!=0)
        {
            double[] positions = new double[0];
            int[] eConnects = new int[0];
            graph.GetGraphData(out positions, out eConnects);

            List<Point3d> pts = new List<Point3d>();

            for (int i = 0; i < positions.Length/3; i++)
            {
                pts.Add(new Point3d(
                    positions[i * 3 + 0],
                    positions[i * 3 + 1],
                    positions[i * 3 + 2]
                ));
            }

            for (int i = 0; i < eConnects.Length/2; i++)
            {
                poly.Add(pts[eConnects[i * 2 + 0]]);
            }
            poly.Add(pts[eConnects[eConnects.Length - 1]]);
        }
        return poly;
    }

    private List<Line> GraphToLines(zExtGraph graph)
    {
        List<Line> lines = new List<Line>();

        if(graph.VertexCount!=0 && graph.EdgeCount!=0)
        {
            double[] positions = new double[0];
            int[] eConnects = new int[0];
            graph.GetGraphData(out positions, out eConnects);

            List<Point3d> pts = new List<Point3d>();

            for (int i = 0; i < positions.Length/3; i++)
            {
                pts.Add(new Point3d(
                    positions[i * 3 + 0],
                    positions[i * 3 + 1],
                    positions[i * 3 + 2]
                ));
            }

            for (int i = 0; i < eConnects.Length/2; i++)
            {
                lines.Add(new Line(
                    pts[eConnects[i * 2 + 0]],
                    pts[eConnects[i * 2 + 1]]
                ));
            }
        }
        return lines;
    }
}
# ---------- end getisocontour ----------

# ---- group: FieldViz
getfieldmesh_3 = CSharpScript(extField=createfield_3.out_field)  # -> out, out_mesh; same code as getfieldmesh
mesh_3 = Mesh(getfieldmesh_3.out_mesh)
data_7 = Data(data_3)
bnd_3 = Bounds(Numbers=data_7)
dedomain_3 = DeconstructDomain(Domain=bnd_3)  # -> Start, End
gradient_3 = Gradient(
    LowerLimit=dedomain_3.Start,
    UpperLimit=dedomain_3.End,
    Parameter=data_7,
    stops=[0: RGB(234, 38, 0), 0.25: RGB(234, 126, 0), 0.5: RGB(254, 244, 84), 0.75: RGB(173, 203, 249), 1: RGB(75, 107, 169)])
c_script_3 = CSharpScript(x=data_7, y="2")  # -> out, a; inputs x: Double, y: Int32; same code as c_script
demesh_3 = DeconstructMesh(Mesh=mesh_3)  # -> Vertices, Faces, Colours, Normals
mcol_3 = MeshColours(Mesh=mesh_3, Colours=gradient_3)
tag_3 = TextTag(Location=demesh_3.Vertices, Text=c_script_3.a)

getfieldmesh_4 = CSharpScript(extField=createfield_4.out_field)  # -> out, out_mesh; same code as getfieldmesh
mesh_4 = Mesh(getfieldmesh_4.out_mesh)
data_8 = Data(data_4)
bnd_4 = Bounds(Numbers=data_8)
dedomain_4 = DeconstructDomain(Domain=bnd_4)  # -> Start, End
gradient_4 = Gradient(
    LowerLimit=dedomain_4.Start,
    UpperLimit=dedomain_4.End,
    Parameter=data_8,
    stops=[0: RGB(234, 38, 0), 0.25: RGB(234, 126, 0), 0.5: RGB(254, 244, 84), 0.75: RGB(173, 203, 249), 1: RGB(75, 107, 169)])
c_script_4 = CSharpScript(x=data_8, y="2")  # -> out, a; inputs x: Double, y: Int32; same code as c_script
demesh_4 = DeconstructMesh(Mesh=mesh_4)  # -> Vertices, Faces, Colours, Normals
mcol_4 = MeshColours(Mesh=mesh_4, Colours=gradient_4)
tag_4 = TextTag(Location=demesh_4.Vertices, Text=c_script_4.a)

# ---- group: GetIsoContour
setfieldvalues_2 = CSharpScript(extField=createfield_3.out_field, scalars=data_3)  # -> out, out_field; inputs scalars: list of Double; same code as setfieldvalues
getisocontour_2 = CSharpScript(extField=setfieldvalues_2.out_field, offset=Slider(0.18, range=0..1))  # -> out, out_contour; inputs offset: Double; same code as getisocontour

# ----
series = Series(Start=Slider(0.12, range=0..1), Step=Slider(0.09, range=0..0.1), Count=Slider(10, range=0..10))

# ---- group: GetIsoContour
number_slider_5 = Slider(0.43, range=0..1)
setfieldvalues_3 = CSharpScript(extField=createfield.out_field, scalars=data_2)  # -> out, out_field; inputs scalars: list of Double; same code as setfieldvalues
getisocontour_3 = CSharpScript(extField=setfieldvalues_3.out_field, offset=series)  # -> out, out_contour; inputs offset: Double; same code as getisocontour

# ---- group: Get&SetFieldValues
setfieldvalues_4 = CSharpScript(extField=createfield_4.out_field, scalars=data_4)  # -> out, out_field; inputs scalars: list of Double; same code as setfieldvalues
getfieldvalues = CSharpScript(extField=setfieldvalues_4.out_field)  # -> out, out_scalars
# ---------- getfieldvalues: C# ----------
// Grasshopper Script Instance
#region Usings
using System;
#r "C:\Users\Taizhong.Chen\AppData\Roaming\Grasshopper\Libraries\zSpace\zSpace.External.dll"
using System.Linq;
using System.Collections;
using System.Collections.Generic;
using System.Drawing;

using Rhino;
using Rhino.Geometry;

using Grasshopper;
using Grasshopper.Kernel;
using Grasshopper.Kernel.Data;
using Grasshopper.Kernel.Types;

using zSpace.External;
#endregion

public class Script_Instance : GH_ScriptInstance
{
    #region Notes
    /* 
      Members:
        RhinoDoc RhinoDocument
        GH_Document GrasshopperDocument
        IGH_Component Component
        int Iteration

      Methods (Virtual & overridable):
        Print(string text)
        Print(string format, params object[] args)
        Reflect(object obj)
        Reflect(object obj, string method_name)
    */
    #endregion

    private void RunScript(object extField, ref object out_scalars)
    {
        zExtMeshField myField = (zExtMeshField) extField;

        out_scalars = myField.GetFieldValues();
    }
}
# ---------- end getfieldvalues ----------

# ---- group: GetIsoContour
getisocontour_4 = CSharpScript(extField=setfieldvalues_4.out_field, offset=Slider(0.1, range=0..1))  # -> out, out_contour; inputs offset: Double; same code as getisocontour

# ----
getfieldgradients = CSharpScript(extField=setfieldvalues_4.out_field)  # -> out, out_gradients
# ---------- getfieldgradients: C# ----------
// Grasshopper Script Instance
#region Usings
using System;
#r "C:\Users\Taizhong.Chen\AppData\Roaming\Grasshopper\Libraries\zSpace\zSpace.External.dll"
using System.Linq;
using System.Collections;
using System.Collections.Generic;
using System.Drawing;

using Rhino;
using Rhino.Geometry;

using Grasshopper;
using Grasshopper.Kernel;
using Grasshopper.Kernel.Data;
using Grasshopper.Kernel.Types;

using zSpace.External;
#endregion

public class Script_Instance : GH_ScriptInstance
{
    #region Notes
    /* 
      Members:
        RhinoDoc RhinoDocument
        GH_Document GrasshopperDocument
        IGH_Component Component
        int Iteration

      Methods (Virtual & overridable):
        Print(string text)
        Print(string format, params object[] args)
        Reflect(object obj)
        Reflect(object obj, string method_name)
    */
    #endregion

    private void RunScript(object extField, ref object out_gradients)
    {
        zExtMeshField myField = (zExtMeshField) extField;

        double[] gradients = myField.GetGradients();

        Vector3d[] vecs = new Vector3d[myField.VertexCount];
        for(int i = 0; i < gradients.Length/3; i++)
        {
            vecs[i] = new Vector3d(
                gradients[i * 3 + 0],
                gradients[i * 3 + 1],
                gradients[i * 3 + 2]
                );
        }

        out_gradients = vecs;
    }
}
# ---------- end getfieldgradients ----------
geo_16 = Geometry(getisocontour.out_contour)
geo_17 = Geometry(getisocontour_3.out_contour)
geo_18 = Geometry(getisocontour_2.out_contour)
demesh_5 = DeconstructMesh(Mesh=mesh_4)  # -> Vertices, Faces, Colours, Normals
getfieldgradients_2 = CSharpScript(extField=setfieldvalues.out_field)  # -> out, out_gradients; same code as getfieldgradients
geo_19 = Geometry(getisocontour_4.out_contour)
getfieldgradients_3 = CSharpScript(extField=setfieldvalues_3.out_field)  # -> out, out_gradients; same code as getfieldgradients
getfieldgradients_4 = CSharpScript(extField=setfieldvalues_2.out_field)  # -> out, out_gradients; same code as getfieldgradients
demesh_6 = DeconstructMesh(Mesh=mesh)  # -> Vertices, Faces, Colours, Normals
demesh_7 = DeconstructMesh(Mesh=mesh_2)  # -> Vertices, Faces, Colours, Normals
vdisex = VectorDisplayEx(Point=demesh_5.Vertices, Vector=getfieldgradients.out_gradients, Colour=RGB(0, 0, 0), Width=1)
demesh_8 = DeconstructMesh(Mesh=mesh_3)  # -> Vertices, Faces, Colours, Normals
c_script_5 = CSharpScript(vec=getfieldgradients.out_gradients)  # -> out, orthonormal; inputs vec: Vector3d
# ---------- c_script_5: C# ----------
// Grasshopper Script Instance
#region Usings
using System;
using System.Linq;
using System.Collections;
using System.Collections.Generic;
using System.Drawing;

using Rhino;
using Rhino.Geometry;

using Grasshopper;
using Grasshopper.Kernel;
using Grasshopper.Kernel.Data;
using Grasshopper.Kernel.Types;
#endregion

public class Script_Instance : GH_ScriptInstance
{
    #region Notes
    /* 
      Members:
        RhinoDoc RhinoDocument
        GH_Document GrasshopperDocument
        IGH_Component Component
        int Iteration

      Methods (Virtual & overridable):
        Print(string text)
        Print(string format, params object[] args)
        Reflect(object obj)
        Reflect(object obj, string method_name)
    */
    #endregion

    private void RunScript(Vector3d vec, ref object orthonormal)
    {
        // Write your logic here
        orthonormal = new Vector3d(-vec.Y, vec.X, vec.Z);
;
    }
}
# ---------- end c_script_5 ----------
c_script_6 = CSharpScript(vec=getfieldgradients_3.out_gradients)  # -> out, orthonormal; inputs vec: Vector3d; same code as c_script_5
vdisex_2 = VectorDisplayEx(Point=demesh_5.Vertices, Vector=c_script_5.orthonormal, Colour=ColourSwatch(SwatchColor=RGB(255, 0, 166)), Width=1)
vdisex_3 = VectorDisplayEx(Point=demesh_6.Vertices, Vector=getfieldgradients_2.out_gradients, Colour=RGB(0, 0, 0), Width=1)
vdisex_4 = VectorDisplayEx(Point=demesh_7.Vertices, Vector=c_script_6.orthonormal, Colour=ColourSwatch(SwatchColor=RGB(0, 64, 255)), Width=1)
vdisex_5 = VectorDisplayEx(
    Point=demesh_7.Vertices,
    Vector=getfieldgradients_3.out_gradients,
    Colour=ColourSwatch(SwatchColor=RGB(255, 0, 102)),
    Width=1)
vdisex_6 = VectorDisplayEx(Point=demesh_8.Vertices, Vector=getfieldgradients_4.out_gradients, Colour=RGB(0, 0, 0), Width=1)
